# Grasshopper definition Chatbot20240523.gh (Grasshopper 1.0.7)
# plug-ins: GhVa20, TbGh20

scdpath = FilePath("D:\软件测试\JHSJB20210104.scd")
scd2xml = CSharpScript(SCDPath=scdpath)  # -> XMLPath; inputs SCDPath: String
# ---------- scd2xml: C# usings ----------
using System.IO;
# ---------- scd2xml: C# ----------
    string sourceFile = SCDPath;
    string targetFile = SCDPath.Replace(".scd", ".xml");
    if(!File.Exists(targetFile))
    {
      System.IO.File.Copy(sourceFile, targetFile, true);
    }
    XMLPath = targetFile;
# ---------- end scd2xml ----------

dxfpath = FilePath("C:\Users\PS\Desktop\test.dxf")
dxf2fam = CSharpScript(DXFPath=dxfpath)  # -> FAMPath; inputs DXFPath: String
# ---------- dxf2fam: C# ----------
    string sourceFile = DXFPath;
    string targetFile = Path.Combine(Path.GetDirectoryName(sourceFile), "0b706daf-1c05-abb8-9f74-7c1283da9db4-0051f9f3.fam");
    //if(!File.Exists(targetFile))
    //{
    System.IO.File.Copy(sourceFile, targetFile, true);
    //}
    FAMPath = targetFile;
# ---------- end dxf2fam ----------

path = FilePath("D:\软件测试\GIM2IFC\GIM2IFC\GIM2IFC\bin\Debug\project.xml")
file = ReadFile(File=path, PerLineParse=True)
getgim_ifctagbox = CSharpScript()  # -> tagBox
# ---------- getgim_ifctagbox: C# usings ----------
using Rhino.DocObjects;
# ---------- getgim_ifctagbox: C# ----------
    RhinoDoc doc = RhinoDoc.ActiveDoc;
    var objects = doc.Objects.GetObjectList(ObjectType.AnyObject);
    List < string > tags = new List<string>(){};
    foreach (RhinoObject rhinoObject in objects)
    {
      GeometryBase geometry = rhinoObject.Geometry;
      BoundingBox bbox = geometry.GetBoundingBox(false);
      double minX = bbox.Min.X;
      double maxX = bbox.Max.X;
      double minY = bbox.Min.Y;
      double maxY = bbox.Max.Y;
      double minZ = bbox.Min.Z;
      double maxZ = bbox.Max.Z;
      string boundingBoxString = "" + bbox.Min.X + "," + bbox.Min.Y + "," + bbox.Min.Z + ";" + bbox.Max.X + "," + bbox.Max.Y + "," + bbox.Max.Z;
      tags.Add(rhinoObject.Attributes.GetUserString("IfcElement_Tag") + ";" + boundingBoxString);
    }
    tagBox = tags;
# ---------- end getgim_ifctagbox ----------
addbox = CSharpScript(xml=file, tagBox=getgim_ifctagbox, path=path)  # inputs xml: list of String, tagBox: list of String, path: String
# ---------- addbox: C# ----------
    List<string> temp = new List<string>();
    foreach(string i in xml)
    {
      string h = i;
      foreach(string j in tagBox)
      {
        string[] tag_box = j.Split(';');
        if (i.Contains(tag_box[0]))
        {
          h = i.Replace("/>", "Min=\"" + tag_box[1] + "\" " + "Max=\"" + tag_box[2] + "\"" + "/>");
        }
      }
      temp.Add(h);
    }
    System.IO.File.WriteAllLines(path.Replace(".xml", "添加包络盒信息.xml"), temp);
# ---------- end addbox ----------

object = Object([<object referenced from the Rhino model> x192])
get_geometry = GetGeometry(object, AtLeast=1, AtMost=1, DeleteInput=False, Filter=1074004029, TreeAccess=False)
bbox = BoundingBox(Content=get_geometry, Plane=PlaneXY(0, 0, 0))  # -> Box, Box_2
getpropval = GetPropertyValue(Object=get_geometry, Property=<missing>)
debox = DeconstructBox(Box=bbox.Box)  # -> Plane, X, Y, Z
dedomain = DeconstructDomain(Domain=debox.X)  # -> Start, End
dedomain_2 = DeconstructDomain(Domain=debox.Y)  # -> Start, End
dedomain_3 = DeconstructDomain(Domain=debox.Z)  # -> Start, End
c_script = CSharpScript(
    name=getpropval,
    xmin=dedomain.Start,
    ymin=dedomain_2.Start,
    zmin=dedomain_3.Start,
    xmax=dedomain.End,
    ymax=dedomain_2.End,
    zmax=dedomain_3.End)  # -> flatten(A); inputs name: String, xmin: Double, ymin: Double, zmin: Double, xmax: Double, ymax: Double, zmax: Double
# ---------- c_script: C# ----------
    A = name + ";" + Convert.ToString(xmin) + "," + Convert.ToString(ymin) + "," + Convert.ToString(zmin) + ";" + Convert.ToString(xmax) + "," + Convert.ToString(ymax) + "," + Convert.ToString(zmax);
# ---------- end c_script ----------
path_2 = FilePath("D:\软件测试\IFCViewer\IFCViewer\IFCViewer\bin\x64\Debug\配电装置楼.xml")
file_2 = ReadFile(File=path_2, PerLineParse=True)
addbox_2 = CSharpScript(xml=file_2, tagBox=c_script, path=path_2)  # inputs xml: list of String, tagBox: list of String, path: String; same code as addbox

本体论xlsx = FilePath("D:\软件测试\本体论.txt")
xlsx2xml = CSharpScript(本体论XLSX=本体论xlsx)  # -> Aout; inputs 本体论XLSX: String
# ---------- xlsx2xml: C# usings ----------
using System.Xml;
using System.Linq;
using System.Text;
using System.IO;
# ---------- xlsx2xml: C# ----------
    Aout = ExportRealXMLCSV(本体论XLSX);
# ---------- xlsx2xml: C# additional code ----------
  public static string ExportRealXMLCSV(string CSVFilePath = "本体论.txt")
  {
    List<string> CSVFileStringList = ReadCSVFile(CSVFilePath);
    CSVFileStringList = RemoveStringListFirst(CSVFileStringList);
    List < int> Level = new List < int> ();
    List < string > Name = new List < string >();
    List < string > Code = new List < string >();
    foreach (string i in CSVFileStringList)
    {
      List<string> j = i.Split('\t').ToList();
      Level.Add(Convert.ToInt32(j[13]));
      Name.Add(j[14]);
      Code.Add(JoinStringList(".", SplitStringList(j, 6)[0]));
    }
    XmlDocument XmlDoc = new XmlDocument();
    XmlElement RootElement = XmlDoc.CreateElement("本体论");
    RootElement.SetAttribute("Name", "本体论");
    RootElement.SetAttribute("Code", "0.0.0.0.0.0");
    RootElement.SetAttribute("Level", "0");
    RootElement.SetAttribute("NodeType", "本体论");
    XmlDoc.AppendChild(RootElement);
    CreateRealXML(Level, Name, Code, XmlDoc, RootElement);
    XmlDoc.Save(CSVFilePath.Replace(".txt", ".xml"));
    return CSVFilePath.Replace(".txt", ".xml");
  }
  public static string CopyString(string String, int Count)
  {
    string Result = "";
    for (int i = 0; i < Count; i++)
    {
      Result += String;
    }
    return Result;
  }
  public static void CreateRealXML(List<int> Level, List<string> Name, List<string> Code, XmlDocument MyXmlDoc, XmlElement MyXmlElement)
  {
    for (int i = 0; i < Level.Count; i++)
    {
      XmlElement Element = MyXmlDoc.CreateElement("本体论");
      if (Level[i] == 1)
      {
        MyXmlElement.AppendChild(Element);
      }
      if (Level[i] == 2)
      {
        MyXmlElement.LastChild.AppendChild(Element);
      }
      if (Level[i] == 3)
      {
        MyXmlElement.LastChild.LastChild.AppendChild(Element);
      }
      if (Level[i] == 4)
      {
        MyXmlElement.LastChild.LastChild.LastChild.AppendChild(Element);
      }
      if (Level[i] == 5)
      {
        MyXmlElement.LastChild.LastChild.LastChild.LastChild.AppendChild(Element);
      }
      Element.SetAttribute("Name", Name[i].Replace("0", ""));
      Element.SetAttribute("Code", Code[i]);
      Element.SetAttribute("Level", Level[i].ToString());
      Element.SetAttribute("NodeType", "本体论");
    }
  }
  public static List<string> ReadCSVFile(string CSVFilePath)
  {
    List < string > CSVFileStringList = new List < string > ();
    using (StreamReader CSVFileReader = new StreamReader(CSVFilePath, Encoding.Default))
    {
      while (!CSVFileReader.EndOfStream)
      {
        string CSVFileLine = CSVFileReader.ReadLine();
        if (CSVFileLine != null)
        {
          CSVFileStringList.Add(CSVFileLine);
        }
      }
    }
    return CSVFileStringList;
  }
  public static List<string> RemoveStringListFirst(List<string> StringList)
  {
    int StringListCount = StringList.Count;
    if (StringListCount != 0)
    {
      int StringListEndIndex = 0;
      StringList.RemoveAt(StringListEndIndex);
    }
    return StringList;
  }
  public static List<List<string>> SplitStringList(List<string> StringList, int StringIndex)
  {
    int StringListCount = StringList.Count;
    if (StringListCount <= 1 || StringIndex == 0 || StringIndex >= StringListCount - 1)
    {
      return new List<List<string>>() { StringList };
    }
    List<string> FirstPart = StringList.GetRange(0, StringIndex);
    List<string> SecondPart = StringList.GetRange(StringIndex, StringListCount - StringIndex);
    return new List<List<string>>() { FirstPart, SecondPart };
  }
  public static string JoinStringList(string StringSeparator, List<string> StringList)
  {
    return string.Join(StringSeparator, StringList);
  }
# ---------- end xlsx2xml ----------
c_script_2 = CSharpScript(ota=xlsx2xml)  # -> A; inputs ota: String
# ---------- c_script_2: C# ----------
    MergeXMlNFiles(ota, "110kV变电站新建工程");
    A = "success";
# ---------- c_script_2: C# additional code ----------
  public static List<string> MergeStringLists(List<string> StringList1, List<string> StringList2)
  {
    StringList1.AddRange(StringList2);
    return StringList1;
  }
  public static void ExportCSVStringList(List<string> StringList, string CSVFilePath = "110kV变电站新建工程属性字段NEW.csv")
  {
    File.WriteAllLines(CSVFilePath, StringList);
  }
  public static string MergeXMlNFiles(string XMLFilePath = @"C:\Users\jinha\Desktop\CaoJinhao\CaoJinhao\bin\Debug\net6.0\本体论.xml", string XMLFilePartName = "110kV变电站新建工程")
  {
    string[] XMLFiles = Directory.GetFiles(Path.GetDirectoryName(XMLFilePath), "*.xml");
    List < string > NewXMLFileStringList = new List < string >();
    foreach (string i in XMLFiles)
    {
      string Name = Path.GetFileNameWithoutExtension(i);
      if (Name != XMLFilePartName && Name.Contains("包络盒"))
      {
        Name = Name.Replace(XMLFilePartName, "");
        List<string> XMLFileStringList = ReadCSVFile(i);
        XMLFileStringList = RemoveStringListFirst(XMLFileStringList);
        XMLFileStringList = XMLFileStringList.Select(item => "      " + item).ToList();
        XMLFileStringList = XMLFileStringList.Select(item => item.Replace("/>", " NodeType=\"" + Name + "\" />")).ToList();
        XMLFileStringList.Insert(0, "    <" + Name + ">");
        XMLFileStringList.Add("    </" + Name + ">");
        NewXMLFileStringList.AddRange(XMLFileStringList);
      }
    }
    NewXMLFileStringList.Insert(0, "  <_110kV变电站新建工程>");
    NewXMLFileStringList.Add("  </_110kV变电站新建工程>");
    List<string> XMLFileStringList0 = ReadCSVFile(XMLFilePath);
    XMLFileStringList0 = RemoveStringListFirst(XMLFileStringList0);
    XMLFileStringList0 = XMLFileStringList0.Select(item => "    " + item).ToList();
    XMLFileStringList0.Insert(0, "  <本体论>");
    XMLFileStringList0.Add("  </本体论>");
    XMLFileStringList0 = MergeStringLists(NewXMLFileStringList, XMLFileStringList0);
    XMLFileStringList0.Insert(0, "<图数据库>");
    XMLFileStringList0.Insert(0, "<?xml version=\"1.0\" encoding=\"utf-8\"?>");
    XMLFileStringList0.Add("</图数据库>");
    ExportCSVStringList(XMLFileStringList0, Path.Combine(Path.GetDirectoryName(XMLFilePath), XMLFilePartName + ".xml"));
    return Path.Combine(Path.GetDirectoryName(XMLFilePath), XMLFilePartName + ".xml");
  }
  public static string ExportRealXMLCSV(string CSVFilePath = "本体论.txt")
  {
    List<string> CSVFileStringList = ReadCSVFile(CSVFilePath);
    CSVFileStringList = RemoveStringListFirst(CSVFileStringList);
    List < int> Level = new List < int> ();
    List < string > Name = new List < string >();
    List < string > Code = new List < string >();
    foreach (string i in CSVFileStringList)
    {
      List<string> j = i.Split('\t').ToList();
      Level.Add(Convert.ToInt32(j[13]));
      Name.Add(j[14]);
      Code.Add(JoinStringList(".", SplitStringList(j, 6)[0]));
    }
    XmlDocument XmlDoc = new XmlDocument();
    XmlElement RootElement = XmlDoc.CreateElement("本体论");
    RootElement.SetAttribute("Name", "本体论");
    RootElement.SetAttribute("Code", "0.0.0.0.0.0");
    RootElement.SetAttribute("Level", "0");
    RootElement.SetAttribute("NodeType", "本体论");
    XmlDoc.AppendChild(RootElement);
    CreateRealXML(Level, Name, Code, XmlDoc, RootElement);
    XmlDoc.Save(CSVFilePath.Replace(".txt", ".xml"));
    return CSVFilePath.Replace(".txt", ".xml");
  }
  public static string CopyString(string String, int Count)
  {
    string Result = "";
    for (int i = 0; i < Count; i++)
    {
      Result += String;
    }
    return Result;
  }
  public static void CreateRealXML(List<int> Level, List<string> Name, List<string> Code, XmlDocument MyXmlDoc, XmlElement MyXmlElement)
  {
    for (int i = 0; i < Level.Count; i++)
    {
      XmlElement Element = MyXmlDoc.CreateElement("本体论");
      if (Level[i] == 1)
      {
        MyXmlElement.AppendChild(Element);
      }
      if (Level[i] == 2)
      {
        MyXmlElement.LastChild.AppendChild(Element);
      }
      if (Level[i] == 3)
      {
        MyXmlElement.LastChild.LastChild.AppendChild(Element);
      }
      if (Level[i] == 4)
      {
        MyXmlElement.LastChild.LastChild.LastChild.AppendChild(Element);
      }
      if (Level[i] == 5)
      {
        MyXmlElement.LastChild.LastChild.LastChild.LastChild.AppendChild(Element);
      }
      Element.SetAttribute("Name", Name[i].Replace("0", ""));
      Element.SetAttribute("Code", Code[i]);
      Element.SetAttribute("Level", Level[i].ToString());
      Element.SetAttribute("NodeType", "本体论");
    }
  }
  public static List<string> ReadCSVFile(string CSVFilePath)
  {
    List < string > CSVFileStringList = new List < string > ();
    using (StreamReader CSVFileReader = new StreamReader(CSVFilePath, Encoding.Default))
    {
      while (!CSVFileReader.EndOfStream)
      {
        string CSVFileLine = CSVFileReader.ReadLine();
        if (CSVFileLine != null)
        {
          CSVFileStringList.Add(CSVFileLine);
        }
      }
    }
    return CSVFileStringList;
  }
  public static List<string> RemoveStringListFirst(List<string> StringList)
  {
    int StringListCount = StringList.Count;
    if (StringListCount != 0)
    {
      int StringListEndIndex = 0;
      StringList.RemoveAt(StringListEndIndex);
    }
    return StringList;
  }
  public static List<List<string>> SplitStringList(List<string> StringList, int StringIndex)
  {
    int StringListCount = StringList.Count;
    if (StringListCount <= 1 || StringIndex == 0 || StringIndex >= StringListCount - 1)
    {
      return new List<List<string>>() { StringList };
    }
    List<string> FirstPart = StringList.GetRange(0, StringIndex);
    List<string> SecondPart = StringList.GetRange(StringIndex, StringListCount - StringIndex);
    return new List<List<string>>() { FirstPart, SecondPart };
  }
  public static string JoinStringList(string StringSeparator, List<string> StringList)
  {
    return string.Join(StringSeparator, StringList);
  }
# ---------- end c_script_2 ----------

panel = Panel("""from neo4j import GraphDatabase
uri = "bolt://localhost:7687"
username = "neo4j"
password = "BIMA0210"
def delete_database():
    with GraphDatabase.driver(uri, auth=(username, password)) as driver:
        with driver.session() as session:
            query = "match (n) detach delete n"
            session.run(query)
def run_database(query):
    with GraphDatabase.driver(uri, auth=(username, password)) as driver:
        with driver.session() as session:
            session.run(query)
delete_database()
run_database(\"\"\"call apoc.import.xml("110kV变电站新建工程.xml") YIELD node RETURN node\"\"\")
run_database("match(p:XmlCharacters) detach delete p")
run_database("match(p)-[r:FIRST_CHILD_OF]->() delete r")
run_database("match(p)-[r:NEXT]->() delete r")
print("导入成功")""")
导入图数据库 = BooleanToggle(True)
importneo4j = CSharpScript(PythonCode=panel, 导入图数据库=导入图数据库)  # -> Result; inputs PythonCode: String, 导入图数据库: Boolean
# ---------- importneo4j: C# usings ----------
using System.Diagnostics;
using System.IO;
using System.Linq;
# ---------- importneo4j: C# ----------
    if (!导入图数据库)
    {
      return;
    }
    string pythonScript = PythonCode;
    ProcessStartInfo start = new ProcessStartInfo();
    start.FileName = @"C:\Users\PS\AppData\Local\Programs\Python\Python37\python";
    start.Arguments = "-c \"" + pythonScript.Replace("\"", "\\\"") + "\"";
    start.UseShellExecute = false;
    start.RedirectStandardOutput = true;
    start.CreateNoWindow = true;
    using (Process process = Process.Start(start))
    {
      using (StreamReader reader = process.StandardOutput)
      {
        Result = reader.ReadToEnd();
      }
    }
# ---------- end importneo4j ----------

panel_2 = Panel("""from neo4j import GraphDatabase
uri = "bolt://localhost:7687"
username = "neo4j"
password = "BIMA0210"
def run_database(query):
    with GraphDatabase.driver(uri, auth=(username, password)) as driver:
        with driver.session() as session:
            session.run(query)
command = \"\"\"match (n{PartName:"IfcWallStandardCase"}) match (m{Code:"14.10.20.3.0.0"}) merge (n)-[:HasClass]->(m)
match (n{PartName:"IfcSlab"}) match (m{Code:"14.10.20.18.0.0"}) merge (n)-[:HasClass]->(m)
match (n{PartName:"IfcBuildingElementProxy"}) match (m{Code:"14.10.20.0.0.0"}) merge (n)-[:HasClass]->(m)
match (n{PartName:"IfcWindow"}) match (m{Code:"14.10.20.12.0.0"}) merge (n)-[:HasClass]->(m)
match (n{PartName:"IfcWall"}) match (m{Code:"14.10.20.3.0.0"}) merge (n)-[:HasClass]->(m)
match (n{PartName:"IfcDoor"}) match (m{Code:"14.10.20.9.0.0"}) merge (n)-[:HasClass]->(m)
match (n{PartName:"IfcRoof"}) match (m{Code:"14.10.20.15.0.0"}) merge (n)-[:HasClass]->(m)
match (n{PartName:"IfcBeam"}) match (m{Code:"14.20.30.6.0.0"}) merge (n)-[:HasClass]->(m)
match (n{PartName:"IfcColumn"}) match (m{Code:"14.20.30.3.0.0"}) merge (n)-[:HasClass]->(m)
match(n{_名称:"110KV变压器电缆终端"}) match(m{Code:"15.26.5.41.0.0"}) merge(n)-[:HasClass]->(m)
match(n{_名称:"110kV中性点成套装置"}) match(m{Code:"15.26.5.42.0.0"}) merge(n)-[:HasClass]->(m)
match(n{_名称:"110kV变压器"}) match(m{Code:"15.26.5.43.0.0"}) merge(n)-[:HasClass]->(m)
match(n{_名称:"中性点电流互感器"}) match(m{Code:"15.26.5.44.0.0"}) merge(n)-[:HasClass]->(m)
match(n{_名称:"中性点避雷器"}) match(m{Code:"15.26.5.45.0.0"}) merge(n)-[:HasClass]->(m)
match(n{_名称:"中性点隔离开关中性点隔离开关"}) match(m{Code:"15.26.5.46.0.0"}) merge(n)-[:HasClass]->(m)
match(n{_名称:"主变中性点电流互感器"}) match(m{Code:"15.26.5.47.0.0"}) merge(n)-[:HasClass]->(m)
match(n{_名称:"交流支柱绝缘子"}) match(m{Code:"15.26.5.48.0.0"}) merge(n)-[:HasClass]->(m)
match(n{_名称:"交流避雷器交流避雷器"}) match(m{Code:"15.26.5.49.0.0"}) merge(n)-[:HasClass]->(m)
match(n{_名称:"变压器中压中性点套管"}) match(m{Code:"15.26.5.50.0.0"}) merge(n)-[:HasClass]->(m)
match(n{_名称:"变压器低压套管"}) match(m{Code:"15.26.5.51.0.0"}) merge(n)-[:HasClass]->(m)
match(n{_名称:"变压器高压套管"}) match(m{Code:"15.26.5.52.0.0"}) merge(n)-[:HasClass]->(m)
match(n{_名称:"油枕"}) match(m{Code:"15.26.5.53.0.0"}) merge(n)-[:HasClass]->(m)
match(n{_名称:"设备线夹"}) match(m{Code:"15.26.5.54.0.0"}) merge(n)-[:HasClass]->(m)
match(n{_名称:"铜铝过渡设备线夹"}) match(m{Code:"15.26.5.55.0.0"}) merge(n)-[:HasClass]->(m)\"\"\".split('\n')
for i in command:
    run_database(i)
print("创建成功")""")
创建知识图谱_新增 = BooleanToggle(False)
createkg = CSharpScript(PythonCode=panel_2, 创建知识图谱=创建知识图谱_新增)  # -> Result; inputs PythonCode: String, 创建知识图谱: Boolean
# ---------- createkg: C# ----------
    if (!创建知识图谱)
    {
      return;
    }
    string pythonScript = PythonCode;
    ProcessStartInfo start = new ProcessStartInfo();
    start.FileName = @"C:\Users\PS\AppData\Local\Programs\Python\Python37\python";
    start.Arguments = "-c \"" + pythonScript.Replace("\"", "\\\"") + "\"";
    start.UseShellExecute = false;
    start.RedirectStandardOutput = true;
    start.CreateNoWindow = true;
    using (Process process = Process.Start(start))
    {
      using (StreamReader reader = process.StandardOutput)
      {
        Result = reader.ReadToEnd();
      }
    }
# ---------- end createkg ----------

# ----
# 自然语言问句转译图数据库查询代码
panel_3 = Panel("油枕的生产厂家是什么")
panel_4 = Panel("""油枕的生产厂家是什么
油枕的属性是什么
有几个油枕
油枕的数量是多少
油枕有几个
有多少个油枕
油枕有多少个
油枕的型式是什么
油枕包含哪些元素""")
创造相似句 = BooleanToggle(False)
panel_5 = Panel("""import jieba
sentence = "SSS"
segments = jieba.cut(sentence, cut_all=False)
segments = list(segments)
templates = ["查询AAA的数量", "查询AAA的BBB的值", "查询AAA包含的BBB", "查询属性包含AAA的BBB", "查询AAA包含的元素", "查询AAA的属性"]
cyphers = [\"\"\"MATCH(n) WHERE(n._名称 CONTAINS "AAA") RETURN COUNT(n) AS PROPERTY\"\"\", \"\"\"MATCH(n) WHERE(n._名称 CONTAINS "AAA") RETURN n._BBB AS PROPERTY, n AS NODE\"\"\", 
\"\"\"MATCH(n{_名称:"AAA"})<-[:IS_CHILD_OF]-(m{_名称:"BBB"}) RETURN m._名称 AS PROPERTY, m AS NODE\"\"\", \"\"\"MATCH(n) WHERE ANY(key in keys(n) WHERE key contains "AAA") RETURN n._名称 AS PROPERTY, n AS NODE\"\"\",
\"\"\"MATCH(n{_名称:"AAA"})<-[:IS_CHILD_OF]-(m) RETURN m._名称 AS PROPERTY, m AS NODE\"\"\", \"\"\"MATCH(n{_名称:"AAA"}) RETURN n._名称 AS PROPERTY, n AS NODE\"\"\"]
results = []
results1 = []
for i in templates:
	index = templates.index(i)
	if "BBB" in i:
		for j in segments:
			for k in segments:
				h = i.replace("AAA", j).replace("BBB", k)
				h1 = cyphers[index].replace("AAA", j).replace("BBB", k)
				results.append(h)
				results1.append(h1)
	else:
		for j in segments:
			h = i.replace("AAA", j)
			h1 = cyphers[index].replace("AAA", j)
			results.append(h)
			results1.append(h1)
import requests
import json
from sentence_transformers import util
API_KEY = "doTuzILqihdVR2qfhIqYvBKn"
SECRET_KEY = "l5EGCNeC3EbF3y7GudbC2ER9eeII50Yu"
def GetSentenceEmbedding(input):
    url = "https://aip.baidubce.com/rpc/2.0/ai_custom/v1/wenxinworkshop/embeddings/embedding-v1?access_token=" + get_access_token()
    payload = json.dumps({ "input": [ input ] })
    headers = { 'Content-Type': 'application/json' }
    response = requests.request("POST", url, headers=headers, data=payload)
    return response.json()["data"][0]["embedding"]
def get_access_token():
    url = "https://aip.baidubce.com/oauth/2.0/token"
    params = {"grant_type": "client_credentials", "client_id": API_KEY, "client_secret": SECRET_KEY}
    return str(requests.post(url, params=params).json().get("access_token"))
scores = []
s1 = GetSentenceEmbedding(sentence)
for i in results:
	s2 = GetSentenceEmbedding(i)
	temp = util.cos_sim(s1, s2)
	scores.append(float(str(temp).replace("tensor([[", "").replace("]])", "")))
import numpy as np
scores = np.array(scores)
results = np.array(results)
results1 = np.array(results1)
sorted_indices = np.argsort(scores)
sorted_scores = scores[sorted_indices]
sorted_results = results[sorted_indices]
sorted_results1 = results1[sorted_indices]
print(sorted_results[-1], ";", sorted_results[-2], ";", sorted_results[-3],sorted_results[-4],sorted_results[-5])
print(sorted_results1[-1], ";", sorted_results1[-2], ";", sorted_results1[-3],sorted_results1[-4],sorted_results1[-5])""")
nl2cypher = CSharpScript(PythonCode=panel_5, NL=panel_3, CreateCypher=创造相似句)  # -> Cypher; inputs PythonCode: String, NL: String, CreateCypher: Boolean
# ---------- nl2cypher: C# ----------
    if (!CreateCypher)
    {
      return;
    }
    string pythonScript = PythonCode;
    pythonScript = pythonScript.Replace("SSS", NL);
    ProcessStartInfo start = new ProcessStartInfo();
    start.FileName = @"C:\Users\PS\AppData\Local\Programs\Python\Python37\python";
    start.Arguments = "-c \"" + pythonScript.Replace("\"", "\\\"") + "\"";
    start.UseShellExecute = false;
    start.CreateNoWindow = true;
    start.RedirectStandardOutput = true;
    using (Process process = Process.Start(start))
    {
      using (StreamReader reader = process.StandardOutput)
      {
        Cypher = reader.ReadToEnd();
      }
    }
# ---------- end nl2cypher ----------
选择第几句 = Slider(2, range=1..3)
相似语句 = Panel(nl2cypher)
split = CSharpScript(result=nl2cypher, n=选择第几句)  # -> cnl, cypher; inputs result: String, n: Int32
# ---------- split: C# ----------
    cnl = result.Split('\n')[0].Split(';')[n - 1];
    cypher = result.Split('\n')[1].Split(';')[n - 1];
# ---------- end split ----------
cnl = Panel(split.cnl)

# ----
# 模板化格式的数据查询输出
queryresult = BooleanToggle(False)
panel_6 = Panel("""from neo4j import GraphDatabase
uri = "bolt://localhost:7687"
username = "neo4j"
password = "BIMA0210"
def run_database(query):
    with GraphDatabase.driver(uri, auth=(username, password)) as driver:
        with driver.session() as session:
            result = session.run(query)
            for record in result:
                a = ""
                try:
                    a = record["NODE"]
                except:
                    pass
                b = ""
                try:
                    b = record["PROPERTY"]
                except:
                    pass
                if a == "":
                    print(b)
                else:
                    print(a, ":", b)
run_database(\"\"\"SSS\"\"\")""")
queryresult_2 = CSharpScript(PythonCode=panel_6, cnl=cnl, cypher=split.cypher, Query=queryresult)  # -> Result; inputs PythonCode: String, cnl: String, cypher: String, Query: Boolean
# ---------- queryresult_2: C# ----------
    if (!Query)
    {
      return;
    }
    string pythonScript = PythonCode.Replace("SSS", cypher);
    ProcessStartInfo start = new ProcessStartInfo();
    start.FileName = @"C:\Users\PS\AppData\Local\Programs\Python\Python37\python";
    start.Arguments = "-c \"" + pythonScript.Replace("\"", "\\\"") + "\"";
    start.UseShellExecute = false;
    start.RedirectStandardOutput = true;
    start.CreateNoWindow = true;
    using (Process process = Process.Start(start))
    {
      using (StreamReader reader = process.StandardOutput)
      {
        Result = reader.ReadToEnd();
      }
    }
    Result = "\"" + cnl + "\"" + "的查询结果:\n" + Result;
# ---------- end queryresult_2 ----------
panel_7 = Panel(queryresult_2)

# ----
# 查询结果的自然语言生成
queryresult2nl = BooleanToggle(False)
panel_8 = Panel("""import requests
import json
API_KEY = "doTuzILqihdVR2qfhIqYvBKn"
SECRET_KEY = "l5EGCNeC3EbF3y7GudbC2ER9eeII50Yu"
def main():
    url = "https://aip.baidubce.com/rpc/2.0/ai_custom/v1/wenxinworkshop/chat/eb-instant?access_token=" + get_access_token()
    payload = json.dumps({ "messages": [{ "role": "user", "content": \"\"\"请用自然语言描述以下查询结果：SSS\"\"\" } ]})
    headers = { 'Content-Type': 'application/json' }
    res = requests.request("POST", url, headers=headers, data=payload).json()
    print(res['result'])
def get_access_token():
    url = "https://aip.baidubce.com/oauth/2.0/token"
    params = {"grant_type": "client_credentials", "client_id": API_KEY, "client_secret": SECRET_KEY}
    return str(requests.post(url, params=params).json().get("access_token"))
if __name__ == '__main__':
    main()""")
queryresult2nl_2 = CSharpScript(PythonCode=panel_8, QueryResult=panel_7, QueryResult2NL=queryresult2nl)  # -> NL; inputs PythonCode: String, QueryResult: String, QueryResult2NL: Boolean
# ---------- queryresult2nl_2: C# ----------
    if (!QueryResult2NL)
    {
      return;
    }
    string PythonScript = PythonCode.Replace("SSS", QueryResult);
    ProcessStartInfo start = new ProcessStartInfo();
    start.FileName = @"C:\Users\PS\AppData\Local\Programs\Python\Python37\python";
    start.Arguments = "-c \"" + PythonScript.Replace("\"", "\\\"") + "\"";
    start.UseShellExecute = false;
    start.RedirectStandardOutput = true;
    start.CreateNoWindow = true;
    using (Process process = Process.Start(start))
    {
      using (StreamReader reader = process.StandardOutput)
      {
        NL = reader.ReadToEnd();
      }
    }
# ---------- end queryresult2nl_2 ----------
panel_9 = Panel(queryresult2nl_2)

panel_10 = Panel("""from neo4j import GraphDatabase
uri = "bolt://localhost:7687"
username = "neo4j"
password = "BIMA0210"
def run_database(query):
    with GraphDatabase.driver(uri, auth=(username, password)) as driver:
        with driver.session() as session:
            session.run(query)
command = \"\"\"match (a)<-[r:HasClass]-(b) delete r\"\"\".split('\n')
for i in command:
    run_database(i)
print("删除成功")""")
创建知识图谱_删除 = BooleanToggle(False)
createkg_2 = CSharpScript(PythonCode=panel_10, 创建知识图谱=创建知识图谱_删除)  # -> Result; inputs PythonCode: String, 创建知识图谱: Boolean; same code as createkg

panel_11 = Panel("""from neo4j import GraphDatabase
uri = "bolt://localhost:7687"
username = "neo4j"
password = "BIMA0210"
def run_database(query):
    with GraphDatabase.driver(uri, auth=(username, password)) as driver:
        with driver.session() as session:
            session.run(query)
command = \"\"\"match(n)-[r:IS_CHILD_OF]->(m) create(n)-[r2:is_child_of]->(m) set r2=r with r delete r\"\"\".split('\n')
for i in command:
    run_database(i)
print("修改成功")""")
创建知识图谱_修改 = BooleanToggle(False)
createkg_3 = CSharpScript(PythonCode=panel_11, 创建知识图谱=创建知识图谱_修改)  # -> Result; inputs PythonCode: String, 创建知识图谱: Boolean; same code as createkg
